# Grasshopper definition testing_workbench.ghx (Grasshopper 1.0.7)
# plug-ins: jSwan, brain_ghplugin

# api.openai.com/v1/chat/completions
# (2024 Update)
panel = Panel("""{
  "model": "gpt-3.5-turbo",
  "messages": [{"role": "user", "content": "Say this is a test!"}],
  "temperature": 0.7
}""")
# api.twitter.com
panel_2 = Panel("Bearer ")
# api.openai.com/v1/completions
panel_3 = Panel("Bearer ")
panel_4 = Panel("""{
    "model": "text-davinci-003",
    "prompt": "Tell me a fairy tale",
    "max_tokens": 16,
    "temperature": 0
}""")
panel_5 = Panel("""{
  "model": "gpt-4-turbo-preview",
  "messages": [
    {
      "role": "system",
      "content": "You are a helpful assistant."
    },
    {
      "role": "user",
      "content": "Tell me a fairy tale"
    }
  ],
  "max_tokens": 16,
  "temperature": 0
}""")
panel_6 = Panel("https://api.twitter.com/2/tweets/search/recent?query=%23ComputationalDesign")
panel_7 = Panel("https://api.openai.com/v1/chat/completions")
panel_8 = Panel("https://api.openai.com/v1/completions")
environment_variable = EnvironmentVariable(Name="OPENAI_API_KEY")
environment_variable_2 = EnvironmentVariable(Name="TWITTER_API_KEY")
number_slider = Slider(10000, range=0..10000)
# www.parametric.camp
panel_9 = Panel("http://www.parametric.camp")
number_slider_2 = Slider(29710, range=1000..100000)
env_var = EnvironmentVariable(Name="OPENAI_API_KEY24")
concatenate = Concatenate(FragmentA=panel_3, FragmentB=environment_variable)
concatenate_2 = Concatenate(FragmentA=panel_2, FragmentB=environment_variable_2)
concat = Concatenate(FragmentA="Bearer ", FragmentB=env_var)

# ---- group: TestCall per API spec
c_script = CSharpScript(url=panel_7, A=concat, R=panel)  # -> out, response; inputs url: String, A: String, R: String; disabled
# ---------- c_script: C# usings ----------
using GH_IO.Serialization;
using System.IO;
using System.Net;
using System.Text;
# ---------- c_script: C# ----------
    if (string.IsNullOrEmpty(url)) return;

    System.Net.ServicePointManager.Expect100Continue = true;
    System.Net.ServicePointManager.SecurityProtocol =
      System.Net.SecurityProtocolType.Tls12;

    var request = (HttpWebRequest) WebRequest.Create(url);

    // Set the request method to POST
    request.Method = "POST";

    // Set the content type to application/json
    request.ContentType = "application/json";

    // Add your API key to the request headers
    request.Headers.Add("Authorization", A);

    // Set the request body if required
    string body = R; // "{\"your\": \"request body\"}";
    byte[] byteArray = Encoding.UTF8.GetBytes(body);
    request.ContentLength = byteArray.Length;
    using (var stream = request.GetRequestStream())
    {
      stream.Write(byteArray, 0, byteArray.Length);
    }

    try
    {
      var res = (HttpWebResponse) request.GetResponse();
      Print(res.StatusDescription);

      Stream dataStream = res.GetResponseStream();
      StreamReader reader = new StreamReader(dataStream);
      response = reader.ReadToEnd();

      reader.Close();
      dataStream.Close();
      res.Close();
    }
    catch (WebException ex)
    {
      Print("Error: " + ex.Message);
      response = ex.Message;
    }
# ---------- end c_script ----------

# ---- group: Getting the model options
get_async = HTTPGETRequestAsync(Send=Toggle(True), Url="https://api.openai.com/v1/models", Authorization=concat, Timeout=number_slider_2)
dejson = DeserializeJson(JSON=get_async, OutputsLocked=False)  # -> Object, Data
dejson_2 = DeserializeJson(JSON=dejson.Data, OutputsLocked=False)  # -> Id, Object, Created, Owned_by

# ---- group: The actual test
post_async = HTTPPostRequestAsync(
    Send=Toggle(True),
    Url=panel_7,
    Body=panel_5,
    ContentType="application/json",
    Authorization=concat,
    Timeout=number_slider_2)
dejson_3 = DeserializeJson(JSON=post_async, OutputsLocked=False)  # -> Id, Object, Created, Model, Choices, Usage, System_fingerprint
dejson_4 = DeserializeJson(JSON=dejson_3.Choices, OutputsLocked=False)  # -> Index, Message, Logprobs, Finish_reason
dejson_5 = DeserializeJson(JSON=dejson_4.Message, OutputsLocked=False)  # -> Role, Content

# ----
httppostrequest = HTTPPostRequestComponent(
    Send=Toggle(False),
    Url=panel_8,
    Body=panel_4,
    ContentType="application/json",
    Authorization=concatenate,
    Timeout=number_slider)
httppostrequest_async = HTTPPostRequestAsync(
    Send=Toggle(False),
    Url=panel_8,
    Body=panel_4,
    ContentType="application/json",
    Authorization=concatenate,
    Timeout=number_slider)
http_get = HTTPGET(Send=Toggle(False), Url=panel_9, Timeout=10000)
http_get_request_async = HTTPGETRequestAsync(Send=Toggle(False), Url="http://www.parametric.camp", Timeout=10000)
http_get_request_async_2 = HTTPGETRequestAsync(Send=Toggle(False), Url=panel_6, Authorization=concatenate_2, Timeout=10000)
error_panel = Panel(post_async)
deserialize_json = DeserializeJson(JSON=httppostrequest, OutputsLocked=False)  # -> Id, Object, Created, Model, Choices, Usage
panel_10 = Panel(httppostrequest_async)
deserialize_json_2 = DeserializeJson(JSON=httppostrequest_async, OutputsLocked=False)  # -> Id, Object, Created, Model, Choices, Usage
panel_11 = Panel(http_get)
panel_12 = Panel(http_get_request_async)
panel_13 = Panel(http_get_request_async_2)
deserialize_json_3 = DeserializeJson(JSON=http_get_request_async_2, OutputsLocked=False)  # -> Data, Meta
deserialize_json_4 = DeserializeJson(JSON=deserialize_json.Choices, OutputsLocked=False)  # -> Text, Index, Logprobs, Finish_reason
deserialize_json_5 = DeserializeJson(JSON=deserialize_json_2.Choices, OutputsLocked=False)  # -> Text, Index, Logprobs, Finish_reason
panel_14 = Panel(c_script.response)
panel_15 = Panel(dejson_5.Content)
deserialize_json_6 = DeserializeJson(JSON=deserialize_json_3.Data, OutputsLocked=False)  # -> Edit_history_tweet_ids, Id, Text
panel_16 = Panel(deserialize_json_4.Text)
panel_17 = Panel(deserialize_json_5.Text)
panel_18 = Panel(deserialize_json_6.Text)
panel_19 = Panel(dejson_2.Id)
